# Grasshopper definition knapsack_galapago.ghx (Grasshopper 1.0.7)

panel = Panel("""5,32.54274347188397
10,2.0774574078314068
8,30.391248563810656
7,16.60491981966792
2,62.5923367577756
6,99.29646273178304
5,52.73816293085557
6,91.00371234361712
3,13.607565685689949
7,36.41113047562538
9,61.07910460748276
9,62.27422691764086
10,57.029192551286776
10,74.27332516716535
2,71.12046388477103
8,81.12848425421065
10,68.51209786555577
5,41.65539566038243
1,28.761955326318677
8,7.210401490832119""")
genes = GenePool(Decimals=0, Maximum=1, Minimum=0, Value=[1, 0, 0, 0, 1, 1, 0, 1, 0, 0, 0, 1, 0, 0, 1, 1, 1, 0, 1, 0])
split = TextSplit(Text=panel, Separators=",")
item = ListItem(List=split, Index=0, Wrap=True)  # -> flatten(Item), flatten(Item1)
python = GhPythonScript(x=item.Item, y=item.Item1)  # -> out, items; inputs x: list, y: list
# ---------- python: Python ----------
items = {}

for i in range(len(x)):
    items[i] = (int(x[i]), float(y[i]))
for item in items.values():
    print(item[0],item[1])
items = [items]
# ---------- end python ----------
python_2 = GhPythonScript(solution=genes, items=python.items)  # -> weight, value; inputs solution: list
# ---------- python_2: Python ----------
NBR_ITEMS = 20
MAX_ITEM = 50
MAX_WEIGHT = 50

# items = items[0]
weight = 0.0
value = 0.0

for i, item in enumerate(solution):
    weight += items[i][0] * item
    value += items[i][1] * item

if weight > MAX_WEIGHT:
    weight = 10000
    value = 0             # Ensure overweighted bags are dominated
# ---------- end python_2 ----------
panel_2 = Panel(python_2.value)
panel_3 = Panel(python_2.weight)
galapagos = Galapagos(fitness=python_2, gene=genes)
