# Grasshopper definition 033_simple_truss.ghx (Grasshopper 1.0.7)

# ----
# Design and Computation
panel = Panel("033_simple_truss.py")
python = GhPythonScript(filename=panel)  # -> path, file; inputs filename: list
# ---------- python: Python ----------
import Grasshopper
import os

filepath = ghenv.Component.OnPingDocument().FilePath
path = os.path.dirname(filepath)
if filename:
    path = os.path.join(path, *filename)


file = None
if os.path.isfile(path):
    with open(path) as f:
        file = f.read()
# ---------- end python ----------
python_2 = GhPythonScript(Code=python.file)

# ----
# Analysis and Visualization
number_slider = Slider(5, range=0..5)
python_3 = GhPythonScript(network=python_2, id=number_slider)  # -> main_topo, nbr_topo; inputs id: Int32
# ---------- python_3: Python ----------
main_topo = network.node_attribute(id, "topology")

nbr_ids = network.neighborhood(id)
print(nbr_ids)
nbr_topo = []
for nbr_id in nbr_ids:
    nbr_topo.append(
        network.node_attribute(nbr_id, "topology")
    )
# ---------- end python_3 ----------
python_4 = GhPythonScript(network=python_2)  # -> topology, types
# ---------- python_4: Python ----------
topology = []
types = []

for node_id in network.nodes():
    topology.append(network.node_attribute(node_id, "topology"))
    types.append(network.node_attribute(node_id, "type"))
# ---------- end python_4 ----------
draw = Draw(cg=python_3.main_topo)  # -> rg
#   port cg: The COMPAS geometry or datastructure to be drawn.
#   port rg: The Rhino geometry object.
# ---------- draw: Python ----------
"""
Draws COMPAS geometry in Grasshopper.
"""
from ghpythonlib.componentbase import executingcomponent as component

from compas.artists import Artist


class CompasToRhinoGeometry(component):
    def RunScript(self, cg):
        if not cg:
            return None

        return Artist(cg).draw()
# ---------- end draw ----------
draw_2 = Draw(cg=python_3.nbr_topo)  # -> rg; same code as draw
draw_3 = Draw(cg=python_4.topology)  # -> rg; same code as draw
preview = CustomPreview(Geometry=draw, Material=ColourSwatch(SwatchColor=RGB(255, 254, 254)))
preview_2 = CustomPreview(Geometry=draw_2, Material=ColourSwatch(SwatchColor=RGB(127, 217, 89)))
